# Grasshopper definition 250201_miesian.gh (Grasshopper 1.0.8)
# plug-ins: RhinoCodePluginGH, Pufferfish, Human, Kangaroo2 Components

number_slider = Slider(400, range=0..400)
desired_area = Slider(200, range=0..500)
number_clusters = Panel("1 to 4")
# INPUTS
size_input_rectangle = Panel("6 to 30")
max_length_wall = Slider(14, range=10..20)
number_sub_clusters = Panel("2 to 4")

max_sub_clusters = Slider(12, range=10..20)
random = Random(Range=size_input_rectangle, Number="2", Seed=number_slider)
round = Round(Number=random)  # -> Nearest, Floor, Ceiling
random_2 = Random(Range=number_clusters, Number=1, Seed=number_slider)
dom = ConstructDomain(DomainStart=expr("x/2*-1", round.Nearest), DomainEnd=expr("x/2", round.Nearest))
# MAIN
item = ListItem(List=dom, Index=0, Wrap=True)  # -> Item, Item1
rectangle = Rectangle(Plane=PlaneXY(0, 0, 0), XSize=item.Item, YSize=item.Item1, Radius=0)  # -> Rectangle, Length
pysubdivide = Python3Script(
    master_rect=rectangle.Rectangle,
    count_sub=random_2,
    seed=number_slider,
    areas=desired_area,
    iterations=Slider(12, range=0..20))  # -> out, flatten(oRects); inputs master_rect: Rectangle3d, count_sub: Int32, seed: Int32, areas: Int32, iterations: Int32
# ---------- pysubdivide: Python ----------
import Rhino.Geometry as rg
import random

def unique_random(count, length):
    random_values = random.sample(range(length + 1), count)
    return random_values


def grow(rect, new_rect, points, rectangles, ind):
    can_grow = False
    diff = int(new_rect.Area - rect.Area)
    pointcount = 0
    ind_to_delete = []
    for i, pt in enumerate(points): 
        if new_rect.Contains(pt) == rg.PointContainment.Inside:
            pointcount += 1
            ind_to_delete.append(i)

    if pointcount == diff:
        for index in sorted(ind_to_delete, reverse=True):
            del points[index]
        can_grow = True
    
    if can_grow:
        rectangles[ind] = new_rect
        return new_rect, 1
    else:
        return rect, 0
    
def create_sub_rectangles(master_rect, count_sub, des_area, maxIteration=1000):
    rectangles = []
    taken = []
    width = int(master_rect.Width)
    height= int(master_rect.Height)
    points = []

    startX = master_rect.Corner(0).X
    startY = master_rect.Corner(0).Y


    for i in range(0, width):
        for j in range(0, height):
            points.append(rg.Point3d(startX + i+.5, startY + j+.5,0))
    for i in unique_random(count_sub, len(points)-1):
        taken.append(i)
        plane = rg.Plane.WorldXY
        plane.Origin = points[i]
        rect = rg.Rectangle3d(plane, rg.Interval(-.5,.5), rg.Interval(-.5,.5))
        rectangles.append(rect) 
    
    for index in sorted(taken, reverse=True):
        del points[index]

    
    growing = 1
    current_area = 0
    it = 0
    #while growing or des_area < current_area:
    while des_area > current_area and it < maxIteration:
        it += 1
        #for k in range(iterations):
        current_area = 0
        growing = 0
        for i, rect in enumerate(rectangles):
            old_rect = rect
            plane = rg.Plane.WorldXY
            plane.Origin = old_rect.Center

            new_rect = rg.Rectangle3d(plane, rg.Interval(-old_rect.Width/2, old_rect.Width/2+1), rg.Interval(-old_rect.Height/2, old_rect.Height/2)) 
            old_rect, test = grow(old_rect, new_rect, points, rectangles, i)
            growing += test
            
            plane = rg.Plane.WorldXY
            plane.Origin = old_rect.Center
            new_rect = rg.Rectangle3d(plane, rg.Interval(-old_rect.Width/2-1, old_rect.Width/2), rg.Interval(-old_rect.Height/2, old_rect.Height/2)) 
            old_rect, test = grow(old_rect, new_rect, points, rectangles, i)
            growing += test

            plane = rg.Plane.WorldXY
            plane.Origin = old_rect.Center
            new_rect = rg.Rectangle3d(plane, rg.Interval(-old_rect.Width/2, old_rect.Width/2), rg.Interval(-old_rect.Height/2-1, old_rect.Height/2)) 
            old_rect, test = grow(old_rect, new_rect, points, rectangles, i)
            growing += test

            plane = rg.Plane.WorldXY
            plane.Origin = old_rect.Center
            new_rect = rg.Rectangle3d(plane, rg.Interval(-old_rect.Width/2, old_rect.Width/2), rg.Interval(-old_rect.Height/2, old_rect.Height/2+1)) 
            old_rect, test = grow(old_rect, new_rect, points, rectangles, i)
            growing += test

            current_area += new_rect.Area

        if not growing:
            print("done growing")
            break
        print(current_area)
    return rectangles,points, growing



random.seed(seed)

# Create the sub-rectangles
sub_rectangles, points,_ = create_sub_rectangles(master_rect, count_sub, areas, iterations)
oRects = sub_rectangles
a = points
# ---------- end pysubdivide ----------
lng = ListLength(List=pysubdivide.oRects)
random_3 = Random(Range=number_sub_clusters, Number=lng, Seed=number_slider)
offset = OffsetCurve(Curve=pysubdivide.oRects, Distance="-1", Corners=1)  # -> flatten(Curve)
panel = Panel(random_3)
panel_2 = Panel("50")
brec = BoundingRectangle(Geometry=pysubdivide.oRects, Plane=PlaneXY(0, 0, 0), Axis=0, Slide=0, Union=True)  # -> Bounding, DimensionX, DimensionY
pysubdivide2 = Python3Script(
    master_rect=offset,
    count_sub=random_3,
    seed=number_slider,
    areas="1000",
    max_clusters=max_sub_clusters,
    iterations=Slider(10, range=0..10))  # -> out, flatten(oRects), pts, a, b, c; inputs master_rect: Rectangle3d, count_sub: Int32, seed: Int32, areas: Int32, max_clusters: Int32, iterations: Int32
# ---------- pysubdivide2: Python ----------
import Rhino.Geometry as rg
import random

def unique_random(count, length):
    random_values = random.sample(range(length + 1), count)
    return random_values


def grow(rect, new_rect, points, rectangles, ind):
    can_grow = False
    diff = int(new_rect.Area - rect.Area)
    pointcount = 0
    ind_to_delete = []
    for i, pt in enumerate(points): 
        if new_rect.Contains(pt) == rg.PointContainment.Inside:
            pointcount += 1
            ind_to_delete.append(i)

    if pointcount == diff:
        for index in sorted(ind_to_delete, reverse=True):
            del points[index]
        can_grow = True
    
    if can_grow:
        rectangles[ind] = new_rect
        return new_rect, 1
    else:
        return rect, 0

b = []
c=[]
def create_sub_rectangles(master_rect, des_area, maxIteration=1000):
    rectangles = []
    taken = []
    width = int(master_rect.Width)
    height= int(master_rect.Height)
    points = []
    selectionPoints = []
    startX = master_rect.Corner(0).X
    startY = master_rect.Corner(0).Y


    for i in range(0, width):
        for j in range(0, height):
            points.append(rg.Point3d(startX + i+.5, startY + j+.5,0))
            if i%2==0 and j%2==0:
                c.append(rg.Point3d(startX + i+.5, startY + j+.5,0))
                selectionPoints.append(rg.Point3d(startX + i+.5, startY + j+.5,0))
    
    max_num_points = int(len(selectionPoints)*.7)
    if max_num_points < 3:
        count_sub = 1
    elif max_num_points < max_clusters:
        count_sub = random.randint(2, max_num_points)
    else: count_sub = max_clusters

    for i in unique_random(count_sub, len(selectionPoints)-1):
        smallest = 100
        ind = -1
        candidate = selectionPoints[i]
        b.append(candidate)
        for j, pt in enumerate(points):
            if pt.DistanceTo(candidate) < smallest:
                smallest = pt.DistanceTo(candidate)
                ind = j
        taken.append(ind)
        plane = rg.Plane.WorldXY
        plane.Origin = points[ind]
        rect = rg.Rectangle3d(plane, rg.Interval(-.5,.5), rg.Interval(-.5,.5))
        rectangles.append(rect) 
    max_iter = 0

    for index in sorted(taken, reverse=True):
        del points[index]

    
    growing = 1
    current_area = 0
    it = 0
    #while growing or des_area < current_area:
    while des_area > current_area and it < maxIteration:
        print(len(points))
        it += 1
        #for k in range(iterations):
        current_area = 0
        growing = 0
        for i, rect in enumerate(rectangles):
            old_rect = rect
            plane = rg.Plane.WorldXY
            plane.Origin = old_rect.Center

            new_rect = rg.Rectangle3d(plane, rg.Interval(-old_rect.Width/2, old_rect.Width/2+1), rg.Interval(-old_rect.Height/2, old_rect.Height/2)) 
            old_rect, test = grow(old_rect, new_rect, points, rectangles, i)
            growing += test
            
            plane = rg.Plane.WorldXY
            plane.Origin = old_rect.Center
            new_rect = rg.Rectangle3d(plane, rg.Interval(-old_rect.Width/2-1, old_rect.Width/2), rg.Interval(-old_rect.Height/2, old_rect.Height/2)) 
            old_rect, test = grow(old_rect, new_rect, points, rectangles, i)
            growing += test

            plane = rg.Plane.WorldXY
            plane.Origin = old_rect.Center
            new_rect = rg.Rectangle3d(plane, rg.Interval(-old_rect.Width/2, old_rect.Width/2), rg.Interval(-old_rect.Height/2-1, old_rect.Height/2)) 
            old_rect, test = grow(old_rect, new_rect, points, rectangles, i)
            growing += test

            plane = rg.Plane.WorldXY
            plane.Origin = old_rect.Center
            new_rect = rg.Rectangle3d(plane, rg.Interval(-old_rect.Width/2, old_rect.Width/2), rg.Interval(-old_rect.Height/2, old_rect.Height/2+1)) 
            old_rect, test = grow(old_rect, new_rect, points, rectangles, i)
            growing += test

            current_area += new_rect.Area

        if not growing:
            print("done growing")
            break
        print(current_area)
    return rectangles, points, growing



random.seed(seed)

# Create the sub-rectangles
sub_rectangles, points,_ = create_sub_rectangles(master_rect, areas, iterations)
oRects = sub_rectangles
a = points
# ---------- end pysubdivide2 ----------
explode = Explode(Curve=brec.Bounding, Recursive=True)  # -> flatten(Segments), Vertices
pt = Point(pysubdivide2.c)
pt_2 = Point(pysubdivide2.b)
explode_2 = Explode(Curve=pysubdivide2.oRects, Recursive=True)  # -> flatten(Segments), Vertices
dupln = RemoveDuplicateLines(Lines=explode_2.Segments, Tolerance=0.01)
crv = Curve(reparameterize(dupln))
len = Length(Curve=crv)
subtraction = Subtraction(A=len, B=".2")
curvepoint = PointOnCurve(crv, parameter=0.5)
division = Division(A=subtraction, B=len)
scale = Scale(Geometry=crv, Center=curvepoint, Factor=division)  # -> Geometry, Transform
area = Area(Geometry=pysubdivide.oRects)  # -> Area, Centroid
area_2 = Area(Geometry=pysubdivide.oRects)  # -> Area, Centroid
ma = MassAddition(Input=area.Area)  # -> Result, PartialResults
ma_2 = MassAddition(Input=area_2.Area)  # -> Result, PartialResults
merge = Merge(Data1=scale.Geometry, Data2=explode.Segments)  # -> flatten(Result)
remap = RemapNumbers(Value=ma.Result, Source="0 to 1000", Target="2 to 3")  # -> Mapped, Clipped
min_wall_height = Panel(remap.Mapped)
remap_2 = RemapNumbers(Value=ma_2.Result, Source="0 to 1000", Target="3 to 4")  # -> Mapped, Clipped
max_wall_height = Panel(remap_2.Mapped)
num = Number(min_wall_height)
pywalls = Python3Script(lines=crv, iMaxLength=max_length_wall, iTestLines=merge, wall_length_bias=Slider(2.1, range=0..10), seed=number_slider)  # -> out, a; inputs lines: list of Curve, iTestLines: list of Curve
# ---------- pywalls: Python ----------
import Rhino.Geometry as rg
import random
import copy

random.seed(seed)
testlines = [line for line in iTestLines]

walls = []

for i in range(len(lines)):
    line = lines[i]
    print("index: " + str(i))

    if not random.randint(0,4): continue

    startpoint = line.PointAt(random.random()*.6+.2)
    direction = rg.Vector3d(line.PointAt(1) - line.PointAt(0)) * [-1,1][random.randint(0,1)]
    direction.Unitize()

    # find longest possible length
    max_length = iMaxLength
    testline = rg.Line(startpoint, startpoint+direction*max_length).ToNurbsCurve()

    test = False
    for line2 in walls:
        intersection = rg.Intersect.Intersection.CurveCurve(testline, line2, 0.01, 0.01)
        if intersection.Count == 1:
            if intersection[0].IsOverlap:
                print(intersection[0].OverlapA)
                test = True
            else:
                dist = startpoint.DistanceTo(intersection[0].PointA)
                if dist < max_length:
                    max_length = dist

    if test: continue

    for line2 in testlines:
        intersection = rg.Intersect.Intersection.CurveCurve(testline, line2, 0.01, 0.01)
        if intersection.Count == 1:
            if not intersection[0].IsOverlap:
                dist = startpoint.DistanceTo(intersection[0].PointA)
                if dist < max_length:
                    max_length = dist
    #print(max_length)
    if max_length < 4:
        continue
    length = random.uniform(4, max_length)

    bias_factor = wall_length_bias
    t = random.uniform(0, 1)
    # Apply a power-law transformation to bias the result
    biased_t = t ** bias_factor
    # Map the biased value back to the range [min_val, max_val]
    max_length = 4 + (max_length - 4) * biased_t

    walls.append(rg.Line(startpoint, startpoint+direction*max_length).ToNurbsCurve())
    #testlines.append(rg.Line(startpoint+direction*0.99, startpoint+direction*max_length*0.99).ToNurbsCurve())

a = walls
# ---------- end pywalls ----------
subtraction_2 = Subtraction(A=max_wall_height, B=num)
division_2 = Division(A=subtraction_2, B=".5")
addition = Addition(A=division_2, B="1")
round_2 = Round(Number=addition)  # -> Nearest, Floor, Ceiling
division_3 = Division(A="1", B=round_2.Nearest)
series = Series(Start=division_3, Step=division_3, Count=round_2.Nearest)
series_2 = Series(Start=num, Step=".5", Count=round_2.Nearest)
graph = GraphMapper(
    series,
    x0=0,
    x1=1,
    y0=0,
    y1=1,
    container_name="Bezier",
    cpx=[0, 0.635866046, 0.9438370466, 1],
    cpy=[0, 0.05761009455, 0.1807985306, 1])
srf = Surface(brec.Bounding)
srf_2 = Surface(pysubdivide.oRects)
Z = UnitZ(Factor=max_wall_height)
move = Move(Geometry=srf_2, Motion=Z)  # -> Geometry, Transform
py3 = Python3Script(curves=pywalls.a, seed=number_slider, heights=series_2, weights=graph)  # -> out, extrusions; inputs curves: list of Curve, seed: Int32, heights: list, weights: list
# ---------- py3: Python ----------
import Rhino.Geometry as rg
import random

random.seed(seed)
extrusions = []

for curve in curves:
    height = random.choices(heights, weights=weights, k=1)[0]
    vector = rg.Vector3d(0, 0, height)
    extrusion = rg.Extrusion.Create(curve, height, True)
    extrusions.append(extrusion)
# ---------- end py3 ----------

walls = Geometry(flatten(py3.extrusions))
# GEO
floors = Geometry(flatten(srf))
roofs = Geometry(flatten(move.Geometry))

relay = Relay([floors, roofs, walls])

Z_2 = UnitZ(Factor=1)
Z_3 = UnitZ(Factor="2")
Z_4 = UnitZ(Factor=1)
move_2 = Move(Geometry=pywalls.a, Motion=Z_2)  # -> Geometry, Transform
move_3 = Move(Geometry=pysubdivide.oRects, Motion=Z_3)  # -> Geometry, Transform
# VIZ
move_4 = Move(Geometry=rectangle.Rectangle, Motion=Z_4)  # -> Geometry, Transform
previewlw = CustomPreviewLineweights(
    Geometry=brec.Bounding,
    Shader=ColourSwatch(SwatchColor=RGB(66, 66, 66)),
    Thickness=Slider(0, range=0..10),
    Absolute=False)
previewlw_2 = CustomPreviewLineweights(Geometry=move_3.Geometry, Shader=ColourSwatch(SwatchColor=RGB(255, 168, 168)), Absolute=False)
previewlw_3 = CustomPreviewLineweights(Geometry=crv, Shader=ColourSwatch(SwatchColor=RGB(209, 209, 209)), Absolute=False)
previewlw_4 = CustomPreviewLineweights(
    Geometry=move_2.Geometry,
    Shader=ColourSwatch(SwatchColor=RGB(255, 255, 255)),
    Thickness=Slider(4, range=0..10),
    Absolute=False)
material = CreateMaterial(
    Diffuse=RGB(255, 105, 180),
    Specular=RGB(255, 255, 255),
    Emission=ColourSwatch(SwatchColor=RGB(173, 173, 173)),
    Transparency=Slider(0.7, range=0..1),
    Shine=0)
preview = CustomPreview(Geometry=relay, Material=material)

srf_3 = Surface(reparameterize(relay))
srf_4 = Surface(srf_3)
lng_2 = ListLength(List=srf_4)
panel_3 = Panel("C:\Users\erik\Documents\25_ijac\dataset\Miesian\orthogonal\")
rec = DataRecorder(lng_2, DataLimit=-10, RecordData=False)
sort = SortList(Keys=rec)  # -> Keys, ValuesA
item_2 = ListItem(List=reverse(sort.Keys), Index=0, Wrap=True)
# MAX COUNT NODES = 29
num_nodes_max = Panel(item_2)
build_dataset = BooleanToggle(False)

# ---- group: cornerpoints
debrep = DeconstructBrep(Brep=srf_3)  # -> Faces, Edges, simplify(Vertices)
ipy2 = IronPython2Script(x=debrep.Vertices)  # -> simplify(out), a; inputs x: list of Point3d
# ---------- ipy2: IronPython ----------
for pt in x:
    print pt.X
    print pt.Y
    print pt.Z
# ---------- end ipy2 ----------

# ---- group: orthogonal
node_feat_thesis = NodeFeatThesis(srf=srf_4)

# ----
cluster = Cluster(srf=srf_4, B=Slider(0.6, range=0..10))  # -> Q, C, degrees_2
node_features = Text(simplify(ipy2.out))
adjacency_matrix = Text(simplify(cluster.C))
panel_4 = Panel(node_features)
path_mapper = PathMapper(adjacency_matrix, source="{A}(i)", target="{0;A}")
# dataset to csv
path_mapper_2 = PathMapper(node_features, source="{A}(i)", target="{0;A}")
python = GhPythonScript(iPath=panel_3, iNodeFeatures=path_mapper_2, iAdjacencyMatrix=path_mapper, iteration=number_slider, x=build_dataset)  # -> out, a; inputs iNodeFeatures: tree, iAdjacencyMatrix: tree, x: Boolean
# ---------- python: Python ----------
import Rhino as rc
import ghpythonlib.treehelpers as tr

def CreateCSV(name, list, it):
    path = iPath + it + name + ".csv"
    file_name = open(path, 'w')
    for row in list:
        all = ""
        for i, str in enumerate(row):
            if i == len(row)-1: all += str 
            else: all += str + ","
        file_name.write(all + "\n")
    file_name.close()

if x:
    nodeFeatures = tr.tree_to_list(iNodeFeatures)
    adjacencyMatrix = tr.tree_to_list(iAdjacencyMatrix)
    
    CreateCSV("nodeFeatures", nodeFeatures, iteration)
    CreateCSV("adjacencyMatrix", adjacencyMatrix, iteration)
    
    print("saved!")
# ---------- end python ----------
panel_5 = Panel(python.out)

# ==== cluster Cluster
srf = ClusterInput()
srf_2 = Surface(reparameterize(srf))
debrep = DeconstructBrep(Brep=srf_2)  # -> flatten(Faces), Edges, graft(Vertices)
srf_cp = SurfaceClosestPoint(Point=debrep.Vertices, Surface=srf_2)  # -> Point, UVPoint, Distance
B = ClusterInput()
smaller = SmallerThan(FirstNumber=srf_cp.Distance, SecondNumber=B)  # -> SmallerThan, OrEqualTo
index = ItemIndex(List=debrep.Faces, Item=debrep.Faces)
cull = CullPattern(List=index, CullPattern=smaller.SmallerThan)  # -> simplify(List)
path_mapper = PathMapper(cull, source="{A;B}", target="{A}")
sort = SortList(Keys=path_mapper)  # -> Keys, ValuesA
dcon = DeleteConsecutive(Set=sort.Keys, Wrap=False)  # -> simplify(Set), Count
area = Area(Geometry=srf_2)  # -> Area, Centroid
item = ListItem(List=area.Centroid, Index=dcon.Set, Wrap=True)
ln = Line(StartPoint=graft(area.Centroid), EndPoint=item)  # -> flatten(Line)
len = Length(Curve=ln)
larger = LargerThan(FirstNumber=len, SecondNumber="0.01")  # -> LargerThan, OrEqualTo
cull_2 = CullPattern(List=ln, CullPattern=larger.LargerThan)
graft = GraftTree(Tree=area.Centroid, IncludeEmptyLists=True, IncludeNullItems=True)
dupln = RemoveDuplicateLines(Lines=cull_2, Tolerance=0.01)  # -> graft(UniqueLines)
index_2 = ItemIndex(List=area.Centroid, Item=area.Centroid)
crv_cp = CurveClosestPoint(Point=area.Centroid, Curve=dupln)  # -> Point, Parameter, Distance
smaller_2 = SmallerThan(FirstNumber=crv_cp.Distance, SecondNumber="0.01")  # -> SmallerThan, OrEqualTo
Q = ClusterOutput(dupln)
lng = ListLength(List=flatten(dupln))
repeat = RepeatData(Data=graft(index_2), Length="2")  # -> flatten(Data)
cull_3 = CullPattern(List=index_2, CullPattern=smaller_2.SmallerThan)  # -> simplify(List)
multiplication = Multiplication(A=lng, B=2)
panel = Panel(multiplication)
rev = ReverseList(List=cull_3)  # -> flatten(List)
merge = Merge(Data1=flatten(cull_3), Data2=rev, Data3=repeat)
partition = PartitionList(List=merge, Size="2")  # -> simplify(Chunks)
flip = FlipMatrix(Data=partition)
bang = ExplodeTree(Data=flip)  # -> Branch0, Branch1
sort_2 = SortList(Keys=bang.Branch0, ValuesA=bang.Branch1)  # -> Keys, ValuesA
lng_2 = ListLength(List=bang.Branch1)
merge_2 = Merge(Data1=sort_2.Keys, Data2=sort_2.ValuesA)
partition_2 = PartitionList(List=merge_2, Size=lng_2)  # -> simplify(Chunks)
bang_2 = ExplodeTree(Data=partition_2)  # -> Branch0, Branch1
equals = Equality(FirstNumber=bang_2.Branch0, SecondNumber=graft(index_2))  # -> Equality, Inequality
num = Number(equals.Equality)
C = ClusterOutput(partition_2)
ma = MassAddition(Input=num)  # -> flatten(Result), PartialResults
subtraction = Subtraction(A=ma.Result, B=1)
degrees = Number(subtraction)
degrees_2 = ClusterOutput(degrees)
panel_2 = Panel(subtraction)

# ==== cluster NodeFeatThesis
srf = ClusterInput()
srf_2 = Surface(srf)
srf_3 = Surface(reparameterize(srf_2))
evalsrf = EvaluateSurface(Surface=simplify(graft(srf_3)), Point="0.5,0.5")  # -> Point, Normal, UDirection, VDirection, Frame
X = UnitX(Factor=1)
Y = UnitY(Factor=1)
Z = UnitZ(Factor=1)
merge = Merge(Data1=Z, Data2=Y, Data3=X)
edges = BrepEdges(Brep=srf_3)  # -> Naked, Interior, NonManifold
angle = Angle(VectorA=merge, VectorB=evalsrf.Normal)  # -> Angle, Reflex
end = EndPoints(Curve=edges.Naked)  # -> Start, End
remap = RemapNumbers(Value=angle.Angle, Source="0 to pi", Target=Domain(0, 1))  # -> Mapped, Clipped
index = ItemIndex(List=angle.Angle, Item=angle.Angle)
vec2pt = Vector2Pt(PointA=end.Start, PointB=end.End, Unitize=False)  # -> Vector, Length
graph = GraphMapper(remap.Mapped, x0=0, x1=1, y0=0, y1=1, container_name="Bezier", cpx=[0, 0, 1, 1], cpy=[0, 1, 1, 0])
division = Division(A=vec2pt.Vector, B=2)
yz = YZPlane(Origin=Point(0, 0, 0))
xz = XZPlane(Origin=Point(0, 0, 0))
xy = XYPlane(Origin=Point(0, 0, 0))
sort = SortList(Keys=graph, ValuesA=index)  # -> Keys, ValuesA
merge_2 = Merge(Data1=xy, Data2=xz, Data3=yz)

# ----
# 0 = xy
# 1 = xz
# 2 = yz
item = ListItem(List=sort.ValuesA, Index=0, Wrap=True)

item_2 = ListItem(List=merge_2, Index=item, Wrap=True)
pl_origin = PlaneOrigin(Base=item_2, Origin=evalsrf.Point)
deplane = DeconstructPlane(Plane=pl_origin)  # -> Origin, XAxis, YAxis, ZAxis
angle_2 = Angle(VectorA=division, VectorB=deplane.XAxis)  # -> simplify(Angle), Reflex
remap_2 = RemapNumbers(Value=angle_2.Angle, Source="0 to pi", Target=Domain(0, 1))  # -> Mapped, Clipped
graph_2 = GraphMapper(remap_2.Mapped, x0=0, x1=1, y0=0, y1=1, container_name="Bezier", cpx=[0, 0, 1, 1], cpy=[0, 1, 1, 0])
sort_2 = SortList(Keys=graph_2, ValuesA=division)  # -> Keys, ValuesA
item_3 = ListItem(List=sort_2.ValuesA, Index=0, Wrap=True)  # -> simplify(Item), Item1, simplify(Item2)
vlen = VectorLength(Vector=sort_2.ValuesA)
item_4 = ListItem(List=vlen, Index=0, Wrap=True)  # -> simplify(Item), Item1, simplify(Item2)
pdecon = Deconstruct(Point=evalsrf.Point)  # -> XComponent, YComponent, ZComponent
merge_3 = Merge(
    Data1=pdecon.XComponent,
    Data2=pdecon.YComponent,
    Data3=pdecon.ZComponent,
    Data4=item,
    Data5=item_4.Item,
    Data6=item_4.Item2)  # -> simplify(Result)
R = ClusterOutput(merge_3)
