# Grasshopper definition midi.gh (Grasshopper 1.0.7)
# plug-ins: Pufferfish, Hops, Human

panel = Panel("C:\Users\ebauscher\OneDrive - Foster + Partners\eb\GradShow\midi_new\latent.csv")
panel_2 = Panel("C:\Users\ebauscher\OneDrive - Foster + Partners\eb\GradShow\midi_new\1planes6rotLin\")
series = Series(Start=0, Step=1, Count="400")
genes = GenePool(Decimals=2, Maximum=1, Minimum=0, Value=[1, 0.82, 1])
python = GhPythonScript(x=panel_2, y=series, z="nodeFeatures.csv")  # -> out, a; inputs y: Int32
# ---------- python: Python ----------
print x + str(y) + z
# ---------- end python ----------
file = ReadFile(File=python.out, PerLineParse=True)  # -> simplify(Content)
concat = Concatenate(FragmentA="[", FragmentB=file)
python_2 = GhPythonScript(iFile=file)  # -> flatten(out), simplify(a), b
# ---------- python_2: Python ----------
import Rhino as rc
import ghpythonlib.treehelpers as tr

values = []
value = ""
for i, letter in enumerate(iFile):
    if letter == ",":
        values.append(float(value))
        value = ""
    elif i == len(iFile)-1:
        value += letter
        values.append(float(value))
    else:
        value += letter

a = values
# ---------- end python_2 ----------
merge = Merge(Data1=file, Data2=",")
concat_2 = Concatenate(FragmentA=concat, FragmentB="]")
concat_3 = Concatenate(FragmentA=concat_2, FragmentB=",")
len = Length()
flip = FlipMatrix(Data=file)
item = ListItem(List=python_2.a, Index=0, Wrap=True)  # -> Item, Item1, Item2, Item3, Item4, Item5, Item6
partition = PartitionList(List=concat_2, Size="21")
hops = Hops(
    Coordinates=genes,
    CacheResultsInMemory=False,
    CacheSolveResults=False,
    RemoteDefinitionLocation="http://127.0.0.1:5000/dream",
    RemoteSolveVersion=(0, 1, 0),
    ShowInput_Enabled=False,
    ShowInput_Path=False,
    SynchronousSolve=True)
xy = XYPlane(Origin=Point(0, 0, 0))
xz = XZPlane(Origin=Point(0, 0, 0))
yz = YZPlane(Origin=Point(0, 0, 0))
path_mapper = PathMapper(python_2.a, source="{A;B}", target="{0;A;B}")
pt = ConstructPoint(XCoordinate=item.Item, YCoordinate=item.Item1, ZCoordinate=item.Item2)
panel_3 = Panel(path_mapper)
demesh = DeconstructMesh(Mesh=hops)  # -> Vertices, Faces, Colours, Normals
merge_2 = Merge(Data1=xy, Data2=xz, Data3=yz)
random = Random(Range="400", Number=1, Seed=Slider(0, range=0..10))
round = Round(Number=random)  # -> flatten(Nearest), Floor, Ceiling
python_3 = GhPythonScript(iFile=path_mapper)  # -> flatten(out), simplify(a), b; inputs iFile: tree
# ---------- python_3: Python ----------
import Rhino as rc
import ghpythonlib.treehelpers as tr
a = []
l = tr.tree_to_list(iFile)

for i in l:
    for ind, j in enumerate(i):
        if ind == len(i)-1:
            a.append(str(j) + "]" + ",")
        elif ind == 0:
            a.append("[" + str(j) + ",")
        else:
            a.append(str(j) + ",")
# ---------- end python_3 ----------
item_2 = ListItem(List=merge_2, Index=item.Item3, Wrap=True)
partition_2 = PartitionList(List=demesh.Vertices, Size="3")
dom = ConstructDomain(DomainStart=expr("x*-1", item.Item5), DomainEnd=item.Item5)
dom_2 = ConstructDomain(DomainStart=expr("x*-1", item.Item4), DomainEnd=item.Item4)
pl_origin = PlaneOrigin(Base=item_2, Origin=pt)
panel_4 = Panel(python_3.a)
item_3 = ListItem(List=partition_2, Index=0, Wrap=True)  # -> Item, Item1, Item2
rectangle = Rectangle(Plane=pl_origin, XSize=dom_2, YSize=dom, Radius=0)  # -> Rectangle, Length

yz_2 = YZPlane(Origin=Point(0, 0, 0))
xz_2 = XZPlane(Origin=Point(0, 0, 0))
xy_2 = XYPlane(Origin=Point(0, 0, 0))
merge_3 = Merge(Data1=xy_2, Data2=xz_2, Data3=yz_2)

pdecon = Deconstruct(Point=item_3.Item1)  # -> XComponent, YComponent, ZComponent
file_2 = ReadFile(File=panel, PerLineParse=True)
panel_5 = Panel(pdecon.XComponent)
mplane = MeshPlane(Boundary=rectangle.Rectangle, WidthCount="1", HeightCount="1")  # -> Mesh, Area

# ----
# glass/no glass
pdecon_2 = Deconstruct(Point=item_3.Item2)  # -> XComponent, YComponent, ZComponent
round_2 = Round(Number=pdecon_2.XComponent)  # -> Nearest, Floor, Ceiling

round_3 = Round(Number=pdecon.XComponent)  # -> Nearest, Floor, Ceiling
python_4 = GhPythonScript(iFile=file_2)  # -> out, simplify(a)
# ---------- python_4: Python ----------
import Rhino as rc
import ghpythonlib.treehelpers as tr

values = []
value = ""
for i, letter in enumerate(iFile):
    if letter == "[" or letter == "]":
        continue
    if letter == ",":
        values.append(value)
        value = ""
    elif i == len(iFile)-1:
        value += letter
        values.append(value)
    else:
        value += letter

a = values
# ---------- end python_4 ----------
path_mapper_2 = PathMapper(mplane.Mesh, source="{A;B}", target="{A}")
panel_6 = Panel(pdecon.ZComponent)
flip_2 = FlipMatrix(Data=python_4.a)
pdecon_3 = Deconstruct(Point=item_3.Item)  # -> XComponent, YComponent, ZComponent
python_5 = GhPythonScript(x=round_3.Nearest, y=pdecon.ZComponent, max=Slider(2.4, range=0..4))  # -> out, a
# ---------- python_5: Python ----------
if x == 0:
    a = y
else:
    if y > max:
        a = max
    else:
        a = y
# ---------- end python_5 ----------
panel_7 = Panel("""0
0
0
1
2
2
2
2
2
1
1
1
1
1
0
1
1
2
2
1
1""")
mjoin = MeshJoin(Meshes=path_mapper_2)  # -> flatten(Mesh)
num = Number(flatten(round_3.Nearest))
item_4 = ListItem(List=merge_3, Index=round_3.Nearest, Wrap=True)
bnd = Bounds(Numbers=flip_2)
panel_8 = Panel(bnd)
bang = ExplodeTree(Data=panel_8)  # -> Branch0, Branch1, Branch2
remap = RemapNumbers(Value=graft(genes), Source=Domain(0, 1), Target=panel_8)  # -> flatten(Mapped), Clipped
box = DomainBox(Base=PlaneXY(0, 0, 0), X=bang.Branch0, Y=bang.Branch1, Z=bang.Branch2)
pt_2 = ConstructPoint(XCoordinate=pdecon_3.XComponent, YCoordinate=pdecon_3.YComponent, ZCoordinate=pdecon_3.ZComponent)
merge_4 = Merge(Data1=graft(num), Data2=graft(panel_7))
item_5 = ListItem(List=python_4.a, Index=0, Wrap=True)  # -> Item, Item1, Item2
pt_3 = Point(Point(-1.06487804, 0, 0))
dom_3 = ConstructDomain(DomainStart=expr("x*-1", python_5.a), DomainEnd=python_5.a)
dom_4 = ConstructDomain(DomainStart=expr("x*-1", pdecon.YComponent), DomainEnd=pdecon.YComponent)
pl_origin_2 = PlaneOrigin(Base=item_4, Origin=pt_2)
flatten = FlattenTree(Tree=item_3.Item, Path="{0}")
pt_4 = ConstructPoint(XCoordinate=item_5.Item, YCoordinate=item_5.Item1, ZCoordinate=item_5.Item2)  # -> flatten(Point)
number_slider = Slider(266, range=0..500)
scale = Scale(Geometry=box, Center=pt_3, Factor=number_slider)  # -> Geometry, Transform
volume = Volume(Geometry=scale.Geometry)  # -> Volume, Centroid
rotate = Rotate(Geometry=scale.Geometry, Angle=degrees(1.570796327), Plane=volume.Centroid)  # -> Geometry, Transform
wires = BrepWireframe(Brep=rotate.Geometry, Density=-1)
previewlw = CustomPreviewLineweights(Geometry=wires, Shader=ColourSwatch(SwatchColor=RGB(255, 255, 255)), Thickness=Slider(1, range=0..10), Absolute=False)
rectangle_2 = Rectangle(Plane=pl_origin_2, XSize=dom_4, YSize=dom_3, Radius=0)  # -> simplify(Rectangle), Length
panel_9 = Panel(flatten)
bbox = BoundingBox(Content=mjoin, Plane=PlaneXY(0, 0, 0))  # -> Box, Box_2
mplane_2 = MeshPlane(Boundary=rectangle_2.Rectangle, WidthCount="1", HeightCount="1")  # -> flatten(Mesh), Area
volume_2 = Volume(Geometry=bbox.Box)  # -> Volume, Centroid
scale_2 = Scale(Geometry=pt_4, Center=pt_3, Factor=number_slider)  # -> Geometry, Transform
item_6 = ListItem(List=remap.Mapped, Index=0, Wrap=True)  # -> Item, Item1, Item2, Item3
bbox_2 = BoundingBox(Content=mplane_2.Mesh, Plane=PlaneXY(0, 0, 0), UnionBox=True)  # -> Box, Box_2
volume_3 = Volume(Geometry=bbox_2.Box)  # -> Volume, Centroid
pt_5 = Point(Point(0, 0, 0))
move2pt = MoveToPoint(Geometry=mplane_2.Mesh, PointA=volume_3.Centroid, PointB=pt_5)  # -> Moved, Vector, Transform
move2pt_2 = MoveToPoint(Geometry=mjoin, PointA=volume_2.Centroid, PointB=scale_2.Geometry)  # -> Moved, Vector, Transform
pt_6 = ConstructPoint(XCoordinate=item_6.Item, YCoordinate=item_6.Item1, ZCoordinate=item_6.Item2)  # -> flatten(Point)
swatch = ColourSwatch(SwatchColor=RGB(0, 0, 0))
scale_3 = Scale(Geometry=pt_6, Center=pt_3, Factor=number_slider)  # -> Geometry, Transform
swatch_2 = ColourSwatch(SwatchColor=RGB(61, 61, 61))
material = CreateMaterial(
    Diffuse=ColourSwatch(SwatchColor=RGB(255, 255, 255)),
    Specular=swatch,
    Emission=swatch,
    Transparency=Slider(0.4, range=0..1),
    Shine=0)
offmsh = OffsetMesh(Mesh=mplane_2.Mesh, Distance=Slider(0.09, range=0..1), BothSides=0, CreateSolid=True)
material_2 = CreateMaterial(
    Diffuse=ColourSwatch(SwatchColor=RGB(0, 229, 255)),
    Specular=swatch_2,
    Emission=swatch_2,
    Transparency=Slider(0.8, range=0..1),
    Shine=0)
cull = CullPattern(List=offmsh, CullPattern=invert(round_2.Nearest))
cull_2 = CullPattern(List=offmsh, CullPattern=round_2.Nearest)
index = ItemIndex(List=move2pt_2.Moved, Item=move2pt_2.Moved)
division = Division(A=index, B="100")
preview = CustomPreview(Geometry=cull_2, Material=material_2)
round_4 = Round(Number=division)  # -> Nearest, Floor, Ceiling
preview_2 = CustomPreview(Geometry=cull, Material=material)
partition_3 = PartitionList(List=move2pt_2.Moved, Size="100")
python_6 = GhPythonScript(x=round_4.Floor)  # -> out, a, b, c
# ---------- python_6: Python ----------
if x==0:
    a = 239
    b = 121
    c = 41

elif x==1:
    a = 55
    b = 70
    c = 234
    
elif x==2:
    a = 58
    b = 143
    c = 32
    
else:
    a = 198
    b = 168
    c = 38
# ---------- end python_6 ----------
group = Group(Objects=partition_3)
pt_7 = Point(Point(0, 0, 0))
pt_8 = Point(Point(0, -53.87657437, 0))
rgb = ColourRGB(Alpha=255, Red=python_6.a, Green=python_6.b, Blue=python_6.c)
addition = Addition(A=rgb, B=ColourSwatch(SwatchColor=RGB(94, 94, 94)))
swatch_3 = ColourSwatch(SwatchColor=RGB(255, 255, 255))
material_3 = CreateMaterial(Diffuse=rgb, Specular=RGB(255, 255, 255), Emission=addition, Transparency=0, Shine=0)
move2pt_3 = MoveToPoint(Geometry=mplane_2.Mesh, PointA=pt_7, PointB=scale_3.Geometry)  # -> Moved, Vector, Transform
material_4 = CreateMaterial(Diffuse=swatch_3, Specular=swatch_3, Emission=swatch_3, Transparency=Slider(0.59, range=0..1), Shine=0)
preview_3 = CustomPreview(Geometry=move2pt_2.Moved, Material=material_3)
preview_4 = CustomPreview(Geometry=move2pt_3.Moved, Material=material_4)
